# Grasshopper definition assignment2.2.1.gh (Grasshopper 0.9.76)
# plug-ins: Python Interpreter

panel = Panel("select <GUID>")
id = Guid(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)
# set thresholds for semantic classification:
# 
# ground level => when it's considered ground
# 
# flat surface => when it's considered a flat roof
# 
# vertical surface => when it's considered a facade
knob = ControlKnob(Decimals=2, Limit=True, Maximum=1, Minimum=0, Range=1, Value=0.5)
knob_2 = ControlKnob(Decimals=2, Limit=True, Maximum=1, Minimum=0.5, Range=1, Value=0.74)
knob_3 = ControlKnob(Decimals=2, Limit=True, Maximum=0.5, Minimum=0, Range=1, Value=0)
# set orientation plane for aspect classification
# set to preview on the right -->
# <-- value*pi
knob_4 = ControlKnob(Decimals=2, Limit=True, Maximum=1, Minimum=0, Range=1, Value=0.34)
# set number of classes for {slope, elevation, aspect} to be displayed in Rhino
# 0 = continuous value
# toggle to display semantic classification
# (only in Rhino)
# 
# purple => ground
# blue => facade
# light blue => flat roof
# yellow,orange,red,darkred => roof: N, E, S, W
number_slider = Slider(3, range=0..20)
c_script = CSharpScript(id=id)  # -> out, P, N, C; inputs id: Guid
# ---------- c_script: C# ----------
    object obj = RhinoDocument.Objects.Find(id);
    if (obj == null)
      return;

    Rhino.DocObjects.PointCloudObject cloudObject = obj as Rhino.DocObjects.PointCloudObject;
    if (cloudObject == null)
      return;
    PointCloud cloud = cloudObject.PointCloudGeometry;

    List<Point3d> points = new List<Point3d>();
    List<Vector3d> normals = null;
    List<Color> colours = null;

    if (cloud.ContainsNormals)
      normals = new List<Vector3d>();
    if (cloud.ContainsColors)
      colours = new List<Color>();

    foreach (PointCloudItem item in cloud)
    {
      points.Add(item.Location);

      if (normals != null)
        normals.Add(item.Normal);
      if (colours != null)
        colours.Add(item.Color);
    }

    P = points;
    N = normals;
    C = colours;
# ---------- end c_script ----------
semantic_classification = BooleanToggle(False)
panel_2 = Panel("set orientation plane")
# choose what type of classification to be displayed:
# (in Rhino + histogram)
list = ValueList({"Elevation": 1, "Slope": 2, "Aspect": 3}, selected="Elevation")
ground_level_threshold = Number(knob)
vertical_surface_threshold = Number(knob_3)
flat_surface_threshold = Number(knob_2)
aspect_orientation = PythonScript(x=knob_4, y=semantic_classification)  # -> out, orientation, plane
# ---------- aspect_orientation: Python ----------
import clr
clr.AddReference('mtrand.dll')

import numpy as np
import Rhino as rh
import Grasshopper as gh
import rhinoscriptsyntax as rsyn

pt = rh.Geometry.Point3d(0,0,0)

xv = np.cos((np.pi)*x)
yv = np.sin((np.pi)*x)
zv = 0

if y == True:
    normvector = rh.Geometry.Vector3d(xv,yv,zv)
    plane = rh.Geometry.Plane(pt, normvector)
    orientation = float((np.pi)*x)
# ---------- end aspect_orientation ----------
pln = Plane(PlaneXY(-0.32582131, -0.4439545359, 0))
number_of_classes = Integer(number_slider)
del = DelaunayMesh(Points=c_script.P, Plane=pln)
pln_2 = Plane(aspect_orientation.plane)
# Turn on process:
true_on = BooleanToggle(True)
python = PythonScript(x=del)  # -> out, a, b, c, d; inputs x: Mesh
# ---------- python: Python ----------
import clr
clr.AddReference('mtrand.dll')

import numpy as np
import Rhino as rh
import Grasshopper as gh
import rhinoscriptsyntax as rsyn


Faces = rsyn.MeshFaces(x, face_type=True)
List_Normals = rsyn.MeshFaceNormals(x)
List_Vertices = rsyn.MeshVertices(x)
List_Face_vertices = rsyn.MeshFaceVertices(x)



a = Faces
b = List_Normals
c = List_Vertices
d = List_Face_vertices
# ---------- end python ----------
calculate = PythonScript(toggle=true_on, vertices=python.c, face_vertex=python.d, face_normals=python.b)  # -> out, a, b; inputs vertices: list, face_vertex: list, face_normals: list
# ---------- calculate: Python ----------
import clr
clr.AddReference('mtrand.dll')

import numpy as np
import Rhino as rh
import Grasshopper as gh
import rhinoscriptsyntax as rsyn

# make dictionary of face_vertex list so that for each vertex the face_ids can be found

FV_dict = dict()
#FV_dict['test'] = ['value1']
#FV_dict['test2'] = ['value2']
#FV_dict['test2'].append('value3')
#print FV_dict

if toggle == True:
    print "starting indexing vertex-faces topology"
    num=0
    for id_face, vertices_ in enumerate(face_vertex):
        num+=1
        if (num%1000)==0:
            print "Processed {} faces".format(str(num))
        for vertex in vertices_:
            if FV_dict.has_key(vertex):
                FV_dict[vertex].add(id_face)
            else:
                FV_dict[vertex] = set([id_face])
        #print id_face
        #print vertices_
    print "Finished indexing: {} faces".format(str(num))


a = FV_dict
#print type(face_normals[1])
#print vertices[1]
#print FV_dict

# calculate normals for vertices
# calculate aspect value per vertex
# slope = normal vector z-axis
print " "
print "Start calculation elevation, slope, aspect"
Vertex_attr = [] # vertices with elevation, slope, aspect, id
num=0
for vertex_id, vertex in enumerate(vertices):
    num+=1
    if (num%1000)==0:
        print "Processed {} points".format(str(num))
    Faces_for_vertex = set(FV_dict[vertex_id])
    List_normals_x = []
    List_normals_y = []
    List_normals_z = []
    for face_id in Faces_for_vertex:
        List_normals_x.append(face_normals[face_id][0])
        List_normals_y.append(face_normals[face_id][1])
        List_normals_z.append(face_normals[face_id][2])
    mean_x = sum(List_normals_x)/len(List_normals_x)
    mean_y = sum(List_normals_y)/len(List_normals_y)
    mean_z = sum(List_normals_z)/len(List_normals_z)
    aspect = np.arctan2(mean_x, mean_y)#/np.pi*180
    elevation = vertex.Z #z-value Point3D
    slope = mean_z
    Vertex_attr.append([vertex, elevation, slope, aspect])

print "Finished indexing: {} points".format(str(num))

b = Vertex_attr
#print b
# ---------- end calculate ----------
classify = PythonScript(
    x=calculate.b,
    analysis=list,
    class_no=number_of_classes,
    semantic=semantic_classification,
    ground_t=ground_level_threshold,
    flat_t=flat_surface_threshold,
    vert_t=vertical_surface_threshold,
    aspect_t=aspect_orientation.orientation)  # -> out, value_list, Pointcloud, Point_list, Color_list; inputs x: list
# ---------- classify: Python ----------
import clr
clr.AddReference('mtrand.dll')

import numpy as np
import Rhino as rh
import Grasshopper as gh
import rhinoscriptsyntax as rsyn

import System
import operator
import scriptcontext
import System.Guid, System.Drawing.Color

pc = rh.Geometry.PointCloud()
num=0


# set selection type of classification
if analysis == 1: selector = 'Elevation'
if analysis == 2: selector = 'Slope'
if analysis == 3: selector = 'Aspect'
if semantic == True: selector = 'Semantic'

print "creating PointCloud with {} classification".format(selector)




# assign RGB values to average (mean) classification value. 
def avg_value_to_RGB(avg_value):
    gamma = 0.8
    wavelength = float(380 + 370*avg_value)
    #print wavelength
    #Based on code by Dan Bruton
    #http://www.physics.sfasu.edu/astro/color/spectra.html
    
    if wavelength >= 380.0 and wavelength <= 440.0:
        attenuation = 0.3 + 0.7 * (wavelength - 380) / (440 - 380)
        R = ((-(wavelength - 440) / (440 - 380)) * attenuation) ** gamma
        G = 0.0
        B = (1.0 * attenuation) ** gamma
    if wavelength >= 440.0 and wavelength <= 490.0:
        R = 0.0
        G = ((wavelength - 440) / (490 - 440)) ** gamma
        B = 1.0
    if wavelength >= 490.0 and wavelength <= 510.0:
        R = 0.0
        G = 1.0
        B = (-(wavelength - 510) / (510 - 490)) ** gamma
    if wavelength >= 510.0 and wavelength <= 580.0:
        R = ((wavelength - 510) / (580 - 510)) ** gamma
        G = 1.0
        B = 0.0
    if wavelength >= 580.0 and wavelength <= 645.0:
        R = 1.0
        G = (-(wavelength - 645) / (645 - 580)) ** gamma
        B = 0.0
    if wavelength >= 645.0 and wavelength <= 750.0:
        attenuation = 0.3 + 0.7 * (750 - wavelength) / (750 - 645)
        R = (1.0 * attenuation) ** gamma
        G = 0.0
        B = 0.0
    R *= 255
    G *= 255
    B *= 255
    RGB_color = (int(R), int(G), int(B))
    #print RGB_color
    return RGB_color

# sets a range of floats for histogram bins
def range_float(minval, maxval, n_o_steps):
    steplist = []
    step = float((maxval-minval)/n_o_steps)
    while minval < maxval:
        steplist.append(minval)
        minval += step
    #steplist.append(maxval)
    return steplist

#print range_float(0, 10, 1)

# returns normalized float between 0 and 1 based on value_list
def normalize_value(val):
    normval=float((val-min(value_list))/(max(value_list)-min(value_list)))
    #print normval
    return normval

# display values for selected analysis
value_list = map(operator.itemgetter(analysis),x)

# classification based on histogram
#hist = np.histogram(value_list, bins = range_float(min(value_list),max(value_list), 256))




# assigning color to points
num = 0
Point_list = []
Color_list = []
#initdisp=rh.Display.CustomDisplay
layer = rh.DocObjects.Layer()
layer.Default
if (semantic == False) and (class_no == 0):
    for entry in x:
        #print type(entry)
        #print type(entry[0])
        num+=1
        if (num%1000)==0: print "inserting {} points".format(str(num))
        RGB_color = avg_value_to_RGB(normalize_value(entry[analysis]))
        #pt=rh.Geometry.Point3d
        pt=entry[0]
        col=System.Drawing.Color.FromArgb(*RGB_color)
        #inst_mat = rh.DocObjects.Material()
        #rh.DocObjects.Material.EmissionColor.SetValue(inst_mat, col)
        pc.Add(pt,col)
        Point_list.append(pt)
        Color_list.append(col)
        #initdisp.AddPoint(pt, col)

def classify_value(value, stepvalues):
    if value >= stepvalues[-1]:
        return 0.9
    for idv, stepval in enumerate(stepvalues):
        if value <= stepval:
            class_value = float((idv)/class_no)
            return class_value
        if value >= stepvalues[-1]:
            return float(1-(1/len(stepvalues)))


if (semantic == False) and (class_no > 0):
    stepvalues = range_float(min(value_list), max(value_list), class_no)
    #print stepvalues
    for entry in x:
        num+=1
        if (num%1000)==0: print "inserting {} points".format(str(num))
        class_value = classify_value(entry[analysis], stepvalues)
        RGB_color2 = avg_value_to_RGB(class_value)
        pt2 = entry[0]
        col2=System.Drawing.Color.FromArgb(*RGB_color2)
        Point_list.append(pt2)
        Color_list.append(col2)

#print aspect_t

if semantic == True:
    for entry in x:
        num+=1
        if (num%1000)==0: print "inserting {} points".format(str(num))
        if entry[1] < ground_t:
            RGB_ground = avg_value_to_RGB(0)
            pt_g = entry[0]
            col_g = System.Drawing.Color.FromArgb(*RGB_ground)
            Point_list.append(pt_g)
            Color_list.append(col_g)
        if (entry[1] > ground_t) and (entry[2] <= vert_t):
            RGB_facade = avg_value_to_RGB(0.15)
            pt_fac = entry[0]
            col_fac = System.Drawing.Color.FromArgb(*RGB_facade)
            Point_list.append(pt_fac)
            Color_list.append(col_fac)
        if (entry[1] > ground_t) and (entry[2] >= flat_t):
            RGB_flatroof = avg_value_to_RGB(0.3)
            pt_fr = entry[0]
            col_fr = System.Drawing.Color.FromArgb(*RGB_flatroof)
            Point_list.append(pt_fr)
            Color_list.append(col_fr)
        if (entry[1] > ground_t) and (entry[2] < flat_t) and (entry[2] > vert_t):
            pt_roof = entry[0]
            Point_list.append(pt_roof)
            ath1 = float(-np.pi+aspect_t)
            ath2 = float((-0.5*(np.pi))+aspect_t)
            ath3 = float(aspect_t)
            ath4 = float((0.5*(np.pi))+aspect_t)
            if entry[3] < ath1:
                RGB_roof = avg_value_to_RGB(1)
            if (entry[3] >= ath1) and (entry[3] < ath2):
                RGB_roof = avg_value_to_RGB(0.5)
            if (entry[3] >= ath2) and (entry[3] < ath3):
                RGB_roof = avg_value_to_RGB(0.65)
            if (entry[3] >= ath3) and (entry[3] < ath4):
                RGB_roof = avg_value_to_RGB(0.85)
            if entry[3] >= ath4:
                RGB_roof = avg_value_to_RGB(1)
            col_roof = System.Drawing.Color.FromArgb(*RGB_roof)
            Color_list.append(col_roof)


print "inserted {} points".format(str(num))

Pointcloud = pc


# adds layer to rhino viewport ##currently not in use
def AddLayer():
    # based on: http://developer.rhino3d.com/samples/rhinocommon/addlayer/
    # Cook up an unused layer name
    scriptcontext.doc = rh.RhinoDoc.ActiveDoc
    unused_name = scriptcontext.doc.Layers.GetUnusedLayerName(False)

    # Prompt the user to enter a layer name
    gs = rh.Input.Custom.GetString()
    gs.SetCommandPrompt(selector)
    gs.SetDefaultString(unused_name)
    gs.AcceptNothing(True)
    gs.Get()
    if gs.CommandResult()!=rh.Commands.Result.Success:
        return gs.CommandResult()

    # Was a layer named entered?
    layer_name = gs.StringResult().Trim()
    if not layer_name:
        print "Layer name cannot be blank."
        return rh.Commands.Result.Cancel

    # Is the layer name valid?
    if not Rhino.DocObjects.Layer.IsValidName(layer_name):
        print layer_name, "is not a valid layer name."
        return rh.Commands.Result.Cancel

    # Does a layer with the same name already exist?
    layer_index = scriptcontext.doc.Layers.Find(layer_name, True)
    if layer_index>=0:
        print "A layer with the name", layer_name, "already exists."
        return rh.Commands.Result.Cancel

    # Add a new layer to the document
    layer_index = scriptcontext.doc.Layers.Add(layer_name, System.Drawing.Color.Black)
    if layer_index<0:
        print "Unable to add", layer_name, "layer."
        return rh.Commands.Result.Failure

    return rh.Commands.Result.Success
# ---------- end classify ----------
bar_graph = BarGraph(classify.value_list, BarColor=RGB(255, 0, 90))
# set dot size
# & display dots (set to preview if needed)
knob_5 = ControlKnob(Decimals=2, Limit=True, Maximum=1, Minimum=0.01, Range=1, Value=0.07)
panel_3 = Panel(classify.out)
panel_4 = Panel(calculate.out)
display_dots = DotDisplay(Point=classify.Point_list, Colour=classify.Color_list, Size=knob_5)
