# Grasshopper definition assignment3.gh (Grasshopper 0.9.76)
# Copyright: All rights reserved
# plug-ins: Python Interpreter, SlingshotDB

# ----
# Point Cloud (PC) input
id = Guid(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)
# Input
c_script = CSharpScript(
    id=id,
    Reference="C:\Users\Balázs\Documents\GEO1004_3D\MathNet.Numerics-3.4.0\MathNet.Numerics\Net40\MathNet.Numerics.dll")  # -> out, P, N, C; inputs id: Guid
# ---------- c_script: C# ----------
    object obj = RhinoDocument.Objects.Find(id);
    if (obj == null)
      return;

    Rhino.DocObjects.PointCloudObject cloudObject = obj as Rhino.DocObjects.PointCloudObject;
    if (cloudObject == null)
      return;
    PointCloud cloud = cloudObject.PointCloudGeometry;

    List<Point3d> points = new List<Point3d>();
    List<Vector3d> normals = null;
    List<Color> colours = null;

    if (cloud.ContainsNormals)
      normals = new List<Vector3d>();
    if (cloud.ContainsColors)
      colours = new List<Color>();

    foreach (PointCloudItem item in cloud)
    {
      points.Add(item.Location);

      if (normals != null)
        normals.Add(item.Normal);
      if (colours != null)
        colours.Add(item.Color);
    }

    P = points;
    N = normals;
    C = colours;
# ---------- end c_script ----------

# ---- group: make a suitable connection string
pgstring = PostgreSQLConnectionString(
    Server="localhost",
    Port="5432",
    UserID="postgres",
    Password="postgres",
    Database="geo1004_3",
    CommandTimeout="20",
    ConnnectionTimeout="5")
patch = VBScript(CString=pgstring)  # -> out, A
# ---------- patch: VB ----------
    '   Patch developed by MSc Geomatics, Rusne Sileryte, in June 2014

    Dim CSList() As  String
    CSList = Cstring.Split(";")
    CSlist(0) = "Driver={PostgreSQL ODBC Driver(UNICODE)}"
    Dim CS As String
    CS = String.Join(";", CSlist)
    A = CS
# ---------- end patch ----------

# ----
create_db_tables = Panel("""CREATE TABLE IF NOT EXISTS pointcloud(id int not null, point geometry, seg_id int, primary key(id));
CREATE TABLE IF NOT EXISTS planes(id int not null, origin geometry, n_x geometry, n_y geometry, n_z geometry, segment int, primary key(id));
CREATE TABLE IF NOT EXISTS building(id int not null, primary key(id));
CREATE TABLE IF NOT EXISTS buildingpart(id int not null, primary key(id));
CREATE TABLE IF NOT EXISTS roofsurface(id int not null, segment int, primary key(id));
CREATE TABLE IF NOT EXISTS wallsurface(id int not null, segment int, primary key(id));
CREATE TABLE IF NOT EXISTS groundsurface(id int not null, segment int, primary key(id));""")

# ----
# Subset the points in the PC for quick calculations in tests.
nr_of_points = Slider(200, range=0..4000)
# TOIDAR:
# The average curvature in the red box is maybe a good reference for a good Cthreshold. If it is not possible to find a good result with these parameters, adjust the search for neighbours.
filtering = BooleanToggle(False)
subset_points = PythonScript(x=c_script.P, range=nr_of_points, switch=filtering)  # -> out, a; inputs x: list, range: Int32
# ---------- subset_points: Python ----------
if switch:
    a = x[0:range]
else:
    a = x
print x[0]
# ---------- end subset_points ----------

curvature_threshold = Slider(0.01, range=0..0.5)
angle_threshold = Slider(4, range=0..45)
cstring = Text(patch.A)
k = Slider(40, range=1..50)

# ----
# Normal and curvature
# estimates
R = Slider(0.5, range=0..5)
fdn = PythonScript(PC=subset_points.a, R=R)  # -> out, a; inputs PC: list of Point3d; disabled
# ---------- fdn: Python ----------
#=========
# Create Fixed Distance Neighbourhoods
#=========

def getNeighboursInRange(PC, R):
    """
    Get the neighbours in range R
    Input:
        PC: point cloud as list of points (Point3d)
        R: the range/radius (float)
    Output:
        list: list: [reference point, pt_1, pt_2, ..., pt_k]
    """
    # create a list of lists of points+neihborhoods as [[point_n, neighbors],[],...]
    FDN_list = [[] for x in xrange(len(PC))]
    for pt in range(len(PC)):
        p = PC[pt]
        # first element in the sublist is the reference point in the neihborhood
        neighbours = []
        for p2 in range(len(PC)):
            # calculate distance for each point in PC
            if p.DistanceTo(PC[p2]) < R:
                neighbours.append((PC[p2], p2))
        # the following elements are the neighbors
        [FDN_list[pt].append(i) for i in neighbours]
    return FDN_list
   

FDN_list = getNeighboursInRange(PC,R)
print FDN_list[0]
a = FDN_list
# ---------- end fdn ----------

# ---- group: First
toggle = BooleanToggle(True)

# ----
odbccommand = ODBCCommand(ConnectionString=cstring, ConnectToggle=toggle, Command=create_db_tables)
panel = Panel(odbccommand)
knn = PythonScript(PC=subset_points.a, k=k)  # -> out, a; inputs PC: list of Point3d, k: Int32
# ---------- knn: Python ----------
import operator

"""
Reference: http://machinelearningmastery.com/tutorial-to-implement-k-nearest-neighbors-in-python-from-scratch/
"""
def getNeighbors(PC, point, k):
    """
    Calculates the k-Nearest Neighbours(k) for each point(point) in a point cloud(PC)
    Input: 
        PC: Point Cloud as list of points (Point3d )
        point: a single reference point (Point3d)
        k: number of points in the neihborhood
    Output:
        list: [reference point, pt_1, pt_2, ..., pt_k]
    """
    distances = []
    for pt in range(len(PC)):
        dist = point.DistanceTo(PC[pt])
        distances.append((PC[pt], dist, pt))
    # sort the distances in ascending order
    distances.sort(key=operator.itemgetter(1)) 
    neighbors = []
    for x in range(k):
        # retrieve the shortest distance
        neighbors.append((distances[x][0], distances[x][2]))
    return neighbors

# create a list of lists of points+neihborhoods as [[point_n, neighbors],[],...]   
kNN_list = [[] for x in xrange(len(PC))] 
for point in range(len(PC)):
    # first element in the sublist is the reference point in the neihborhood
    #kNN_list[point].append((PC[point],point))
    neighbors = getNeighbors(PC, PC[point], k)
    # the following elements are the neighbors
    [kNN_list[point].append(i) for i in neighbors]
    
a = kNN_list
# ---------- end knn ----------
norm_curv = PythonScript(neighbors=knn.a)  # -> out, N, Cur, Pt; inputs neighbors: list
# ---------- norm_curv: Python ----------
import clr
clr.AddReference("mtrand")

import math
import operator 
import numpy as np
from numpy import linalg as LA
import Rhino.Geometry as RG

#=======================
# Estimation of normals
#=======================
covM = [] # the list of covariance matrices
#point_a = np.empty([len(neighbors[0]),3]) # a single empty array shaped as an input for the covariance matrix

for Pgroup in range(len(neighbors)):
    point_a = np.empty([len(neighbors[Pgroup]),3])
    #print 'this is the structure of the coordinate matrix per neighbourhood: ' + str(point_a)
    for point in range(len(neighbors[Pgroup])):
        #print neighbors[Pgroup][point]
        #print 'this is point: ' + str(point) + ' before coordinate insertion'
        #print str(point_a[point])
        point_a[point][0] = neighbors[Pgroup][point][0][0] # X
        #print str(neighbors[Pgroup][point][0])
        #print str(neighbors[Pgroup][point][0][0])
        #print str(neighbors[Pgroup][point][0][1])
        #print str(neighbors[Pgroup][point][0][2])
        point_a[point][1] = neighbors[Pgroup][point][0][1] # Y
        point_a[point][2] = neighbors[Pgroup][point][0][2] # Z
        #print 'this is point: ' + str(point) + ' after coordinate insertion'
        #print str(point_a[point]) 
    #print point_a
    m = np.cov(point_a, rowvar=0) #each column represents a variable, while the rows contain observations
    #print m
    covM.append(m)

normals = []
curvature = []
#index = 0
for m in range(len(neighbors)):
   # calculate eigenvalues (e_vals) and eigenvectors (e_vecs)
   e_vals, e_vecs = LA.eig(covM[m])
   #print e_vals, e_vecs
   # get the index of the smallest eigenvalue
   eMin = np.argmin(e_vals)
   # calculate curvature at point
   c = e_vals[eMin]/sum(e_vals)
   curvature.append(c)
   # retrieve the smallest eigenvector corresponding to the smallest eigenvalue
   normal = e_vecs[:,eMin]
   # cast normal coordinates into floats
   normal = [float(i) for i in normal]
   # create a Vector3d from each normal
   normals.append([neighbors[m],RG.Vector3d(normal[0],normal[1],normal[2]),c])

# curvature list output for visualizing them
Cur = [float(i) for i in curvature]

#=======================
# Check if the direction of the normals are in align with the point of origin of the LIDAR laser beam
Z = RG.Vector3d(0,0,1)
normals_copy = normals[:]
for i in range(len(normals_copy)):
    v = normals_copy[i][1]
    # unitize normals
    v.Unitize()
    # compute dot product of Z unit vector and normal
    dp = RG.Vector3d.Multiply(Z,v) 
    if dp < 0.0:
        # if dot product negative, reverse vector
        normals[i][1].Reverse()

# normal list output for visualizing them
x=[]
for i in normals:
    x.append(i[-2])
N=x

Pt = normals
# ---------- end norm_curv ----------
avr = Average(Input=norm_curv.Cur)
panel_2 = Panel(avr)
region_growing = PythonScript(PC=norm_curv.Pt, cTh=curvature_threshold, aTh=angle_threshold)  # -> out, seg_ID, nr_seg, seg_3d; inputs PC: list
# ---------- region_growing: Python ----------
import Rhino.Geometry as RG
from collections import deque
import math
import copy

# Create a point dictionary for quick access as: 
# {Reference point(ID): [Ref_geometry(Point3d), Ref_curvature(Float), Ref_normal(Vector3d),[list of neighbors(ID)]]}
PC_dict = dict()
for i in range(len(PC)):
    n_list = []
    for j in PC[i][0][1:]:
        n_list.append(j[1])
    PC_dict[PC[i][0][0][1]] = [PC[i][0][0][0], PC[i][2], PC[i][1], n_list]

"""
About Rhino GUID in Grasshopper:
"After any manipulation, of the originally referenced Point from Rhino, it will 
loose the Guid and subsequently other Rhino informations and it`s pretty hard to 
find the right guid again. So i would try to keep your Guid from the beginning in 
your script."
http://www.grasshopper3d.com/forum/topics/guid-of-an-object
"""
"""
Region growing algorithm for point cloud segmentation. 
Implementaion of the algorithm from here:
http://pointclouds.org/documentation/tutorials/region_growing_segmentation.php
Input:
    PC: List(Point3d). Point Cloud as list of points.
    N: List(Vector3d). Normal vectors as list of vectors.
    c: List(Float). Curvature estimates for each point.
    cTh: Float. Curvature threshold.
    aTh: Float. Angle threshold in degrees.
Output:
    R_list: List(Point3d). Region list.    
"""
R_list = [] # Region list
PC_cp = copy.deepcopy(PC_dict)
    
while len(PC_cp) > 0:
    Rc = []
    Sc = []
    Pmin = min(PC_cp, key=PC_cp.get)
    Rc.append(Pmin)
    Sc = deque([Pmin]) # create a queue (FIFO structure)
    print 'Initiated seed list: ' + str(Sc[0])
    while len(Sc) > 0:
        Bc = PC_cp[Sc[0]][3]
        print 'initiated neighbourhood '+str(Bc)+' for seed '+str(Sc[0])
        for j in Bc:
            if PC_cp.has_key(j):
                v1,v2 = PC_cp[Sc[0]][2],PC_cp[j][2]
                # check if angle difference 1.0 indicate identical points
                if RG.Vector3d.VectorAngle(v1, v2) * (180/math.pi) < aTh:
                #if RG.Vector3d.Multiply(v1,v2) > aTh:
                    Rc.append(j) # optionally also append Vector3d
                    if PC_cp[j][1] < cTh:
                        if j not in Sc:
                            Sc.append(j)
                            print str(j)+' added to seed list'
                    #del PC_cp[j]
                    #print str(j)+' deleted from PC_cp'
        print 'removing '+str(Sc[0])+' from PC_cp'
        del PC_cp[Sc[0]]
        print 'removing '+str(Sc[0])+' from seed list'
        Sc.popleft()
        print 'new seed list is: ' + str(Sc)
    R_list.append(Rc)

# output only the point IDs for the respective segment
seg_ID = R_list
# number of segments for quick check
nr_seg = len(R_list)

# output segment-points as Point3d
segment = []
for seg in R_list:
    segment.append([PC_dict[ref_id][0] for ref_id in seg])
seg_3d = segment
# ---------- end region_growing ----------
nr_of_segments = Panel(region_growing.nr_seg)
roof_to_db = PythonScript()  # -> out; inputs roof: list
# ---------- roof_to_db: Python ----------
cmd_line = "INSERT INTO roofsurface(id, segment) VALUES("+id+", "+segment+");"
# ---------- end roof_to_db ----------
planes = PythonScript(PC=norm_curv.Pt, seg_ID=region_growing.seg_ID, cTh=Slider(0.01, range=0..0.1))  # -> out, planes, points, points_ID, o, n; inputs PC: list, seg_ID: list
# ---------- planes: Python ----------
import Rhino.Geometry as RG
from Grasshopper import DataTree
from Grasshopper.Kernel.Data import GH_Path

# Create a point dictionary for quick access as: 
# {Reference point(ID): [Ref_geometry(Point3d), Ref_curvature(Float), Ref_normal(Vector3d),[list of neighbors(ID)]]}
PC_dict = dict()
for i in range(len(PC)):
    n_list = []
    #print PC[i]
    for j in PC[i][0][1:]:
        n_list.append(j[1])
    PC_dict[PC[i][0][0][1]] = [PC[i][0][0][0], PC[i][2], PC[i][1], n_list]

# =======================
# Sort faces from corners and create planes
# =======================
pts = []
pts_ID = []
pls = []
idx = 0
for segment in seg_ID:
    # segments that have less than 3 points are discarded
    if len(segment) >= 3:
        # Get average curvature of the segment
        cur = [PC_dict[pt][1] for pt in segment]
        cur = sum(cur)/len(cur)
        # If the the avg. curvature is below the threshold, thus it is planar
        # and represents a face not a corner, create a plane.
        if cur < cTh:
            tmp = [PC_dict[pt][0] for pt in segment]
            pt_n = [(pt, PC_dict[pt][0], PC_dict[pt][2]) for pt in segment]
            pl = RG.Plane.FitPlaneToPoints(tmp)[1]
            #o,n = pls.Origin, pls.Normal
            pls.append(pl)
            pts.append(pt_n)
            pts_ID.append((idx,segment))
            idx += 1
            #points = [PC_dict[pt][0] for pt in segment]
            #planes = RG.Plane.FitPlaneToPoints(tmp)[1]
        else:
            continue
    else:
        continue

#o = len(pls)

planes = pls
points = pts

#tree_pts = DataTree[object]()
#for i in range(len(pts)):
#    temp = pts[i]
#    path = GH_Path(i)
#    tree_pts.AddRange(temp, path)
#points = tree_pts

points_ID = pts_ID
# ---------- end planes ----------

plane_to_db = PythonScript(plane=planes.planes, segment=planes.points_ID)  # -> out; inputs plane: list, segment: list
# ---------- plane_to_db: Python ----------
for n,i in enumerate(plane):
    id = str(n)
    origin = str(i.Origin)
    n_x = str(i.XAxis)
    n_y = str(i.YAxis)
    n_z = str(i.ZAxis)
    segment = str(n)
    cmd_line = "INSERT INTO planes(id, origin, n_x, n_y, n_z, segment) VALUES("+id+", ST_MakePoint("+origin+"), ST_MakePoint("+n_x+"), ST_MakePoint("+n_y+"), ST_MakePoint("+n_z+"), "+segment+");"
    print cmd_line
# ---------- end plane_to_db ----------
seg_to_db = PythonScript(segment=planes.points_ID)  # -> out; inputs segment: list
# ---------- seg_to_db: Python ----------
for i in segment:
    id = str(i[0]) # segment id
    for k in i[1]:
        pt = str(k) # point id in the segment
        cmd_line = "UPDATE pointcloud SET seg_id="+id+" WHERE id="+pt+";"
        print cmd_line
# ---------- end seg_to_db ----------
pc_to_db = PythonScript(PC=norm_curv.Pt)  # -> out; inputs PC: list
# ---------- pc_to_db: Python ----------
for i in range(len(PC)):
    id = str(PC[i][0][0][1])
    pt = str(PC[i][0][0][0])
    cmd_line = "INSERT INTO pointcloud(id, point) VALUES("+id+" ,ST_MakePoint("+pt+"));"
    print cmd_line

cmd_line = "CREATE UNIQUE INDEX pc_idx ON pointcloud (id);"
print cmd_line
# ---------- end pc_to_db ----------
odbccommand_2 = ODBCCommand(ConnectionString=cstring, ConnectToggle=Button(), Command=pc_to_db)
odbccommand_3 = ODBCCommand(ConnectionString=cstring, ConnectToggle=Button(), Command=seg_to_db)
odbccommand_4 = ODBCCommand(ConnectionString=cstring, ConnectToggle=Button(), Command=plane_to_db)
panel_3 = Panel(odbccommand_2)
panel_4 = Panel(odbccommand_3)
panel_5 = Panel(odbccommand_4)

odbccommand_5 = ODBCCommand(ConnectionString=cstring, ConnectToggle=Button(), Command=roof_to_db)
dom = ConstructDomain(DomainStart=Slider(0, range=0..20), DomainEnd=Slider(15, range=0..20))
panel_6 = Panel(odbccommand_5)
planesrf = PlaneSurface(Plane=PlaneXY(0, 0, 0), XSize=dom, YSize=dom)  # disabled
del = DelaunayMesh(Points=planes.points, Plane=planes.planes)  # disabled

# ----
# Visualization
curvature = Number(norm_curv.Cur)
N = Numbers(curvature)
bnd = Bounds(Numbers=N)
de = DeconstructDomain(Domain=bnd)  # -> Start, End
gradient = Gradient(LowerLimit=de.Start, UpperLimit=de.End, Parameter=N, stops=[0: RGB(0, 128, 0), 0.5: RGB(255, 255, 0), 1: RGB(255, 0, 0)])
curvature_2 = CustomPreview(Geometry=subset_points.a, Shader=gradient)

# ---- group: Visualize point neighborhoods
point_nr = Slider(105, range=0..1000)
point_size = Slider(0.1, range=0..0.1)
i = Integer(point_nr)
python = PythonScript(x=norm_curv.N, i=i)  # -> out, A; inputs x: list
# ---------- python: Python ----------
points = x[i]
A = points
# ---------- end python ----------
item = ListItem(List=subset_points.a, Index=i, Wrap=True)
dots = DotDisplay(Point=python.A, Colour=RGB(0, 0, 0), Size=point_size)
ln = Line(StartPoint=item, EndPoint=python.A)
dots_2 = DotDisplay(Point=item, Colour=RGB(255, 110, 110), Size=point_size)

# ----
select_segment = PythonScript(x=region_growing.seg_3d, y=Slider(78, range=0..94))  # -> out, a; inputs x: list, y: Int32; disabled
# ---------- select_segment: Python ----------
a = x[y]
# ---------- end select_segment ----------

# ---- group: Visualize normals
short = ShortestList(ListA=subset_points.a, ListB=norm_curv.N, TrimMode=2)  # -> ListA, ListB
vdis = VectorDisplay(Anchor=short.ListA, Vector=short.ListB)

# ----
dots_3 = DotDisplay(Point=select_segment.a, Colour=RGB(42, 88, 177), Size=point_size)  # disabled
calculate = PythonScript(points=planes.points)  # -> out, a, b; inputs points: list
# ---------- calculate: Python ----------
import clr
clr.AddReference('mtrand.dll')

import numpy as np
import Rhino as rh
import Grasshopper as gh
import rhinoscriptsyntax as rsyn

# # make dictionary of face_vertex list so that for each vertex the face_ids can be found

# FV_dict = dict()
# #FV_dict['test'] = ['value1']
# #FV_dict['test2'] = ['value2']
# #FV_dict['test2'].append('value3')
# #print FV_dict

# if toggle == True:
    # print "starting indexing vertex-faces topology"
    # num=0
    # for id_face, vertices_ in enumerate(face_vertex):
        # num+=1
        # if (num%1000)==0:
            # print "Processed {} faces".format(str(num))
        # for vertex in vertices_:
            # if FV_dict.has_key(vertex):
                # FV_dict[vertex].add(id_face)
            # else:
                # FV_dict[vertex] = set([id_face])
        # #print id_face
        # #print vertices_
    # print "Finished indexing: {} faces".format(str(num))


# a = FV_dict
# #print type(face_normals[1])
# #print vertices[1]
# #print FV_dict

# # calculate normals for vertices
# # calculate aspect value per vertex
# # slope = normal vector z-axis
# print " "
# print "Start calculation elevation, slope, aspect"
Vertex_attr = [] # vertices with elevation, slope, aspect, id
# num=0
# for vertex_id, vertex in enumerate(vertices):
    # num+=1
    # if (num%1000)==0:
        # print "Processed {} points".format(str(num))
    # Faces_for_vertex = set(FV_dict[vertex_id])
    # List_normals_x = []
    # List_normals_y = []
    # List_normals_z = []
    # for face_id in Faces_for_vertex:
        # List_normals_x.append(face_normals[face_id][0])
        # List_normals_y.append(face_normals[face_id][1])
        # List_normals_z.append(face_normals[face_id][2])
    # mean_x = sum(List_normals_x)/len(List_normals_x)
    # mean_y = sum(List_normals_y)/len(List_normals_y)
    # mean_z = sum(List_normals_z)/len(List_normals_z)
for segment in points:
    for pt in segment:
        n = pt[2]
        p = pt[1]
        aspect = np.arctan2(n.X, n.Y)#/np.pi*180
        elevation = p.Z #z-value Point3D
        slope = n.Z
        Vertex_attr.append([p, elevation, slope, aspect])

# print "Finished indexing: {} points".format(str(num))

b = Vertex_attr
#print b
# ---------- end calculate ----------

# ----
# choose what type of classification to be displayed:
# (in Rhino + histogram)
# set number of classes for {slope, elevation, aspect} to be displayed in Rhino
# 0 = continuous value
# toggle to display semantic classification
# (only in Rhino)
# 
# purple => ground
# blue => facade
# light blue => flat roof
# yellow,orange,red,darkred => roof: N, E, S, W
# set thresholds for semantic classification:
# 
# ground level => when it's considered ground
# 
# flat surface => when it's considered a flat roof
# 
# vertical surface => when it's considered a facade
# set dot size
# & display dots (set to preview if needed)
# set orientation plane for aspect classification
# set to preview on the right -->
# <-- value*pi
knob = ControlKnob(Decimals=2, Limit=True, Maximum=1, Minimum=0, Range=1, Value=0.5)
knob_2 = ControlKnob(Decimals=2, Limit=True, Maximum=1, Minimum=0.5, Range=1, Value=0.74)
knob_3 = ControlKnob(Decimals=2, Limit=True, Maximum=0.5, Minimum=0, Range=1, Value=0)
knob_4 = ControlKnob(Decimals=2, Limit=True, Maximum=1, Minimum=0, Range=1, Value=0.34)
semantic_classification = BooleanToggle(True)
list = ValueList({"Elevation": 1, "Slope": 2, "Aspect": 3}, selected="Slope")
vertical_surface_threshold = Number(knob_3)
ground_level_threshold = Number(knob)
flat_surface_threshold = Number(knob_2)
aspect_orientation = PythonScript(x=knob_4, y=semantic_classification)  # -> out, orientation, plane
# ---------- aspect_orientation: Python ----------
import clr
clr.AddReference('mtrand.dll')

import numpy as np
import Rhino as rh
import Grasshopper as gh
import rhinoscriptsyntax as rsyn

pt = rh.Geometry.Point3d(0,0,0)

xv = np.cos((np.pi)*x)
yv = np.sin((np.pi)*x)
zv = 0

if y == True:
    normvector = rh.Geometry.Vector3d(xv,yv,zv)
    plane = rh.Geometry.Plane(pt, normvector)
    orientation = float((np.pi)*x)
# ---------- end aspect_orientation ----------
number_of_classes = Integer(Slider(3, range=0..20))
pln = Plane(aspect_orientation.plane)
classify = PythonScript(
    x=calculate.b,
    analysis=list,
    class_no=number_of_classes,
    semantic=semantic_classification,
    ground_t=ground_level_threshold,
    flat_t=flat_surface_threshold,
    vert_t=vertical_surface_threshold,
    aspect_t=aspect_orientation.orientation)  # -> out, value_list, Pointcloud, Point_list, Color_list; inputs x: list
# ---------- classify: Python ----------
import clr
clr.AddReference('mtrand.dll')

import numpy as np
import Rhino as rh
import Grasshopper as gh
import rhinoscriptsyntax as rsyn

import System
import operator
import scriptcontext
import System.Guid, System.Drawing.Color

pc = rh.Geometry.PointCloud()
num=0


# set selection type of classification
if analysis == 1: selector = 'Elevation'
if analysis == 2: selector = 'Slope'
if analysis == 3: selector = 'Aspect'
if semantic == True: selector = 'Semantic'

print "creating PointCloud with {} classification".format(selector)




# assign RGB values to average (mean) classification value. 
def avg_value_to_RGB(avg_value):
    gamma = 0.8
    wavelength = float(380 + 370*avg_value)
    #print wavelength
    #Based on code by Dan Bruton
    #http://www.physics.sfasu.edu/astro/color/spectra.html
    
    if wavelength >= 380.0 and wavelength <= 440.0:
        attenuation = 0.3 + 0.7 * (wavelength - 380) / (440 - 380)
        R = ((-(wavelength - 440) / (440 - 380)) * attenuation) ** gamma
        G = 0.0
        B = (1.0 * attenuation) ** gamma
    if wavelength >= 440.0 and wavelength <= 490.0:
        R = 0.0
        G = ((wavelength - 440) / (490 - 440)) ** gamma
        B = 1.0
    if wavelength >= 490.0 and wavelength <= 510.0:
        R = 0.0
        G = 1.0
        B = (-(wavelength - 510) / (510 - 490)) ** gamma
    if wavelength >= 510.0 and wavelength <= 580.0:
        R = ((wavelength - 510) / (580 - 510)) ** gamma
        G = 1.0
        B = 0.0
    if wavelength >= 580.0 and wavelength <= 645.0:
        R = 1.0
        G = (-(wavelength - 645) / (645 - 580)) ** gamma
        B = 0.0
    if wavelength >= 645.0 and wavelength <= 750.0:
        attenuation = 0.3 + 0.7 * (750 - wavelength) / (750 - 645)
        R = (1.0 * attenuation) ** gamma
        G = 0.0
        B = 0.0
    R *= 255
    G *= 255
    B *= 255
    RGB_color = (int(R), int(G), int(B))
    #print RGB_color
    return RGB_color

# sets a range of floats for histogram bins
def range_float(minval, maxval, n_o_steps):
    steplist = []
    step = float((maxval-minval)/n_o_steps)
    while minval < maxval:
        steplist.append(minval)
        minval += step
    #steplist.append(maxval)
    return steplist

#print range_float(0, 10, 1)

# returns normalized float between 0 and 1 based on value_list
def normalize_value(val):
    normval=float((val-min(value_list))/(max(value_list)-min(value_list)))
    #print normval
    return normval

# display values for selected analysis
value_list = map(operator.itemgetter(analysis),x)

# classification based on histogram
#hist = np.histogram(value_list, bins = range_float(min(value_list),max(value_list), 256))




# assigning color to points
num = 0
Point_list = []
Color_list = []
#initdisp=rh.Display.CustomDisplay
layer = rh.DocObjects.Layer()
layer.Default
if (semantic == False) and (class_no == 0):
    for entry in x:
        #print type(entry)
        #print type(entry[0])
        num+=1
        if (num%1000)==0: print "inserting {} points".format(str(num))
        RGB_color = avg_value_to_RGB(normalize_value(entry[analysis]))
        #pt=rh.Geometry.Point3d
        pt=entry[0]
        col=System.Drawing.Color.FromArgb(*RGB_color)
        #inst_mat = rh.DocObjects.Material()
        #rh.DocObjects.Material.EmissionColor.SetValue(inst_mat, col)
        pc.Add(pt,col)
        Point_list.append(pt)
        Color_list.append(col)
        #initdisp.AddPoint(pt, col)

def classify_value(value, stepvalues):
    if value >= stepvalues[-1]:
        return 0.9
    for idv, stepval in enumerate(stepvalues):
        if value <= stepval:
            class_value = float((idv)/class_no)
            return class_value
        if value >= stepvalues[-1]:
            return float(1-(1/len(stepvalues)))


if (semantic == False) and (class_no > 0):
    stepvalues = range_float(min(value_list), max(value_list), class_no)
    #print stepvalues
    for entry in x:
        num+=1
        if (num%1000)==0: print "inserting {} points".format(str(num))
        class_value = classify_value(entry[analysis], stepvalues)
        RGB_color2 = avg_value_to_RGB(class_value)
        pt2 = entry[0]
        col2=System.Drawing.Color.FromArgb(*RGB_color2)
        Point_list.append(pt2)
        Color_list.append(col2)

#print aspect_t

if semantic == True:
    for entry in x:
        num+=1
        if (num%1000)==0: print "inserting {} points".format(str(num))
        if entry[1] < ground_t:
            RGB_ground = avg_value_to_RGB(0)
            pt_g = entry[0]
            col_g = System.Drawing.Color.FromArgb(*RGB_ground)
            Point_list.append(pt_g)
            Color_list.append(col_g)
        if (entry[1] > ground_t) and (entry[2] <= vert_t):
            RGB_facade = avg_value_to_RGB(0.15)
            pt_fac = entry[0]
            col_fac = System.Drawing.Color.FromArgb(*RGB_facade)
            Point_list.append(pt_fac)
            Color_list.append(col_fac)
        if (entry[1] > ground_t) and (entry[2] >= flat_t):
            RGB_flatroof = avg_value_to_RGB(0.3)
            pt_fr = entry[0]
            col_fr = System.Drawing.Color.FromArgb(*RGB_flatroof)
            Point_list.append(pt_fr)
            Color_list.append(col_fr)
        if (entry[1] > ground_t) and (entry[2] < flat_t) and (entry[2] > vert_t):
            pt_roof = entry[0]
            Point_list.append(pt_roof)
            ath1 = float(-np.pi+aspect_t)
            ath2 = float((-0.5*(np.pi))+aspect_t)
            ath3 = float(aspect_t)
            ath4 = float((0.5*(np.pi))+aspect_t)
            if entry[3] < ath1:
                RGB_roof = avg_value_to_RGB(1)
            if (entry[3] >= ath1) and (entry[3] < ath2):
                RGB_roof = avg_value_to_RGB(0.5)
            if (entry[3] >= ath2) and (entry[3] < ath3):
                RGB_roof = avg_value_to_RGB(0.65)
            if (entry[3] >= ath3) and (entry[3] < ath4):
                RGB_roof = avg_value_to_RGB(0.85)
            if entry[3] >= ath4:
                RGB_roof = avg_value_to_RGB(1)
            col_roof = System.Drawing.Color.FromArgb(*RGB_roof)
            Color_list.append(col_roof)


print "inserted {} points".format(str(num))

Pointcloud = pc


# adds layer to rhino viewport ##currently not in use
def AddLayer():
    # based on: http://developer.rhino3d.com/samples/rhinocommon/addlayer/
    # Cook up an unused layer name
    scriptcontext.doc = rh.RhinoDoc.ActiveDoc
    unused_name = scriptcontext.doc.Layers.GetUnusedLayerName(False)

    # Prompt the user to enter a layer name
    gs = rh.Input.Custom.GetString()
    gs.SetCommandPrompt(selector)
    gs.SetDefaultString(unused_name)
    gs.AcceptNothing(True)
    gs.Get()
    if gs.CommandResult()!=rh.Commands.Result.Success:
        return gs.CommandResult()

    # Was a layer named entered?
    layer_name = gs.StringResult().Trim()
    if not layer_name:
        print "Layer name cannot be blank."
        return rh.Commands.Result.Cancel

    # Is the layer name valid?
    if not Rhino.DocObjects.Layer.IsValidName(layer_name):
        print layer_name, "is not a valid layer name."
        return rh.Commands.Result.Cancel

    # Does a layer with the same name already exist?
    layer_index = scriptcontext.doc.Layers.Find(layer_name, True)
    if layer_index>=0:
        print "A layer with the name", layer_name, "already exists."
        return rh.Commands.Result.Cancel

    # Add a new layer to the document
    layer_index = scriptcontext.doc.Layers.Add(layer_name, System.Drawing.Color.Black)
    if layer_index<0:
        print "Unable to add", layer_name, "layer."
        return rh.Commands.Result.Failure

    return rh.Commands.Result.Success
# ---------- end classify ----------
bar_graph = BarGraph(classify.value_list, BarColor=RGB(255, 0, 90))
calculate_2 = PythonScript()  # -> out, a, b; inputs vertices: list, face_vertex: list, face_normals: list
# ---------- calculate_2: Python ----------
import clr
clr.AddReference('mtrand.dll')

import numpy as np
import Rhino as rh
import Grasshopper as gh
import rhinoscriptsyntax as rsyn

# make dictionary of face_vertex list so that for each vertex the face_ids can be found

FV_dict = dict()
#FV_dict['test'] = ['value1']
#FV_dict['test2'] = ['value2']
#FV_dict['test2'].append('value3')
#print FV_dict

if toggle == True:
    print "starting indexing vertex-faces topology"
    num=0
    for id_face, vertices_ in enumerate(face_vertex):
        num+=1
        if (num%1000)==0:
            print "Processed {} faces".format(str(num))
        for vertex in vertices_:
            if FV_dict.has_key(vertex):
                FV_dict[vertex].add(id_face)
            else:
                FV_dict[vertex] = set([id_face])
        #print id_face
        #print vertices_
    print "Finished indexing: {} faces".format(str(num))


a = FV_dict
#print type(face_normals[1])
#print vertices[1]
#print FV_dict

# calculate normals for vertices
# calculate aspect value per vertex
# slope = normal vector z-axis
print " "
print "Start calculation elevation, slope, aspect"
Vertex_attr = [] # vertices with elevation, slope, aspect, id
num=0
for vertex_id, vertex in enumerate(vertices):
    num+=1
    if (num%1000)==0:
        print "Processed {} points".format(str(num))
    Faces_for_vertex = set(FV_dict[vertex_id])
    List_normals_x = []
    List_normals_y = []
    List_normals_z = []
    for face_id in Faces_for_vertex:
        List_normals_x.append(face_normals[face_id][0])
        List_normals_y.append(face_normals[face_id][1])
        List_normals_z.append(face_normals[face_id][2])
    mean_x = sum(List_normals_x)/len(List_normals_x)
    mean_y = sum(List_normals_y)/len(List_normals_y)
    mean_z = sum(List_normals_z)/len(List_normals_z)
    aspect = np.arctan2(mean_x, mean_y)#/np.pi*180
    elevation = vertex.Z #z-value Point3D
    slope = mean_z
    Vertex_attr.append([vertex, elevation, slope, aspect])

print "Finished indexing: {} points".format(str(num))

b = Vertex_attr
#print b
# ---------- end calculate_2 ----------
knob_5 = ControlKnob(Decimals=2, Limit=True, Maximum=1, Minimum=0.01, Range=1, Value=0.07)
panel_7 = Panel(classify.out)
display_dots = DotDisplay(Point=classify.Point_list, Colour=classify.Color_list, Size=knob_5)
